# Dynamo graph 01 Scan to BIM.dyn (Dynamo 2.12.1.8246)

file_path = Filename(".\point_coords.csv")
importCSV = Data.ImportCSV(filePath=file_path)
python_script = Python(IN[0]=importCSV)  # IronPython2
# ---------- python_script.python (18 lines) ----------
# Load the Python Standard and DesignScript Libraries
import sys
import clr
clr.AddReference('ProtoGeometry')
from Autodesk.DesignScript.Geometry import *

# The inputs to this node will be stored as a list in the IN variables.
dataEnteringNode = IN

x, y, z = [], [], []
# Place your code below this line
for i in range(10000):
	x.append (dataEnteringNode[0][0][i])
	y.append (dataEnteringNode[0][1][i])
	z.append (dataEnteringNode[0][2][i])

# Assign your output to the OUT variable.
OUT = x, y, z
# ----------------------------------------
code_block = CodeBlock(list=python_script) { list[0]; list[1]; list[2]; }
byCoordinates = Point.ByCoordinates(x=code_block.out0, y=code_block.out1, z=code_block.out2)
code_block_2 = CodeBlock { 1; }
pruneDuplicates = Point.PruneDuplicates(points=byCoordinates, tolerance=code_block_2)
code_block_3 = CodeBlock { 2; }
groupByDistance = Python(IN[0]=pruneDuplicates, IN[1]=code_block_3)  # "Geometry.GroupByDistance"; IronPython2
# ---------- groupByDistance.python (26 lines) ----------
#Copyright(c) 2016, Dimitar Venkov
# @5devene, dimitar.ven@gmail.com
#Inspired from the "Group Curves" node by Konrad Sobon
# @arch_laboratory, http://archi-lab.net

import clr
clr.AddReference('ProtoGeometry')
from Autodesk.DesignScript.Geometry import Geometry

pts = IN[0]
margin = IN[1]
dist1 = Geometry.DistanceTo

Groups, Queue = [], []
while pts:
	group = []
	Queue.append(pts.pop() )
	while Queue:
		p1 = Queue.pop()
		group.append(p1)
		for i in xrange(len(pts)-1,-1,-1):
			if dist1(p1, pts[i]) <= margin:
				Queue.append(pts.pop(i) )
	Groups.append(group)

OUT = Groups
# ----------------------------------------
count = List.Count(list=groupByDistance@L2)
code_block_4 = CodeBlock { 10; }
gt = count > code_block_4
filterByBoolMask = List.FilterByBoolMask(list=groupByDistance, mask=gt)
byBestFitThroughPoints = Line.ByBestFitThroughPoints(bestFitPoints=filterByBoolMask.in)
byLoft = Surface.ByLoft(crossSections=byBestFitThroughPoints)
code_block_5 = CodeBlock { -1; }
code_block_6 = CodeBlock { false; }
thicken = Surface.Thicken(surface=byLoft, thickness=code_block_5, both_sides=code_block_6)
categories = Categories("OST_GenericModel")
string = StringInput("Asphalt, Pavement, Light Grey")
byName = Material.ByName(name=string)
string_2 = StringInput("Highway")
byGeometry = DirectShape.ByGeometry(geometry=thicken, category=categories, material=byName, name=string_2)
